# Grasshopper definition icons.gh (Grasshopper 1.0.8)
# plug-ins: Heteroptera, treesloth01, Pufferfish, GrasshopperRender, Pigletto, eleFront5

geometry = Geometry([<brep referenced from the Rhino model> x4])
geometry_2 = Geometry(<brep referenced from the Rhino model>)
geometry_3 = Geometry([<brep referenced from the Rhino model> x2])
geometry_4 = Geometry(<brep referenced from the Rhino model>)
mesh = Mesh(geometry)
mesh_2 = Mesh(geometry_2)
mesh_3 = Mesh(geometry_3)
mesh_join = MeshJoin(Meshes=mesh)
mesh_4 = Mesh(geometry_4)
pigture_material = PigtureMaterial(
    Preset="White Plaster",
    Color=ColourSwatch(SwatchColor=RGB(0, 166, 105)),
    Opacity=Slider(0.55, range=0..1),
    SelectedPreset="Toon Green")  # -> Material, Preview
pigture_material_2 = PigtureMaterial(
    Preset="White Plaster",
    Color=ColourSwatch(SwatchColor=RGB(240, 240, 240)),
    Opacity=Slider(0.55, range=0..1),
    SelectedPreset="White Plaster")  # -> Material, Preview
get_current_file = GetCurrentFile()  # -> Folder, FileName, Worksession
geometry_5 = Geometry(<brep referenced from the Rhino model>)
mesh_join_2 = MeshJoin(Meshes=mesh_2)
geometry_6 = Geometry(<brep referenced from the Rhino model>)
pigture_material_3 = PigtureMaterial(
    Preset="White Plaster",
    Color=ColourSwatch(SwatchColor=RGB(38, 38, 38)),
    Opacity=Slider(0.55, range=0..1),
    SelectedPreset="Marble Black")  # -> Material, Preview
get_current_file_2 = GetCurrentFile()  # -> Folder, FileName, Worksession
mesh_join_3 = MeshJoin(Meshes=mesh_3)
pigture_material_4 = PigtureMaterial(
    Preset="White Plaster",
    Color=ColourSwatch(SwatchColor=RGB(0, 166, 105)),
    Opacity=Slider(0.55, range=0..1),
    SelectedPreset="Toon Green")  # -> Material, Preview
mesh_join_4 = MeshJoin(Meshes=mesh_4)
bounding_rectangle = BoundingRectangle(Geometry=geometry, Plane=PlaneXY(0, 0, 0), Axis=0, Slide=0, Union=True)  # -> Bounding, DimensionX, DimensionY
center = Center(Geometry=geometry, forall=True)  # -> Center, Dimension
bounding_rectangle_2 = BoundingRectangle(Geometry=geometry_4, Plane=PlaneXY(0, 0, 0), Axis=0, Slide=0, Union=True)  # -> Bounding, DimensionX, DimensionY
center_2 = Center(Geometry=geometry_4, forall=True)  # -> Center, Dimension
mesh_5 = Mesh(geometry_5)
mesh_6 = Mesh(geometry_6)
concatenate = Concatenate(FragmentA=get_current_file.Folder, FragmentB="\OrcaSlicericon.png")
concatenate_2 = Concatenate(FragmentA=get_current_file_2.Folder, FragmentB="\BambuSlicericon.png")
data_tree_match = DataTreeMatch(Guide=geometry, Match=pigture_material.Material)  # -> Guide, Matched
render_attributes = RenderAttributes(ObjectMaterial=data_tree_match.Matched)  # -> Render, ObjectMaterial, CastsShadows, ReceivesShadows
add_material = AddMaterial(Material=pigture_material_2.Material)
add_material_2 = AddMaterial(Material=pigture_material_3.Material)
get_current_file_3 = GetCurrentFile()  # -> Folder, FileName, Worksession
pigture_material_5 = PigtureMaterial(
    Preset="White Plaster",
    Color=ColourSwatch(SwatchColor=RGB(227, 227, 227)),
    Opacity=Slider(0.55, range=0..1),
    SelectedPreset="White Plaster")  # -> Material, Preview
mesh_join_5 = MeshJoin(Meshes=mesh_5)
pigture_material_6 = PigtureMaterial(
    Preset="White Plaster",
    Color=ColourSwatch(SwatchColor=RGB(214, 87, 28)),
    Opacity=Slider(0.55, range=0..1),
    SelectedPreset="Toon Orange")  # -> Material, Preview
add_material_3 = AddMaterial(Material=pigture_material_4.Material)
mesh_join_6 = MeshJoin(Meshes=mesh_6)
discontinuity = Discontinuity(Curve=bounding_rectangle.Bounding, Level=1)  # -> Points, Parameters
set_material = SetMaterial(Object=mesh_join_2, Material=add_material)  # -> Object, Material
discontinuity_2 = Discontinuity(Curve=bounding_rectangle_2.Bounding, Level=1)  # -> Points, Parameters
bounding_rectangle_3 = BoundingRectangle(Geometry=geometry_6, Plane=PlaneXY(0, 0, 0), Axis=0, Slide=0, Union=True)  # -> Bounding, DimensionX, DimensionY
center_3 = Center(Geometry=geometry_6, forall=True)  # -> Center, Dimension
group = Group(Geometry=data_tree_match.Guide)
concatenate_3 = Concatenate(FragmentA=get_current_file_3.Folder, FragmentB="\PrusaSlicericon.png")
add_material_4 = AddMaterial(Material=pigture_material_5.Material)
set_material_2 = SetMaterial(Object=mesh_join_3, Material=add_material_2)  # -> Object, Material
list_item = ListItem(List=discontinuity.Points, Index=0, Wrap=True)  # -> Item, Item1, Item2
set_material_3 = SetMaterial(Object=mesh_join_4, Material=add_material_3)  # -> Object, Material
model_object = ModelObject(Geometry=geometry, Render=render_attributes.Render)  # -> Object, Geometry, Name, Layer, Visibility, Display, Drafting, Render
add_material_5 = AddMaterial(Material=pigture_material_6.Material)
list_item_2 = ListItem(List=discontinuity_2.Points, Index=0, Wrap=True)  # -> Item, Item1, Item2
discontinuity_3 = Discontinuity(Curve=bounding_rectangle_3.Bounding, Level=1)  # -> Points, Parameters
set_material_4 = SetMaterial(Object=mesh_join, Material=pigture_material.Material)  # -> Object, Material
distance = Distance(PointA=list_item.Item, PointB=list_item.Item2)
unit_z = UnitZ(Factor=distance)
distance_2 = Distance(PointA=list_item_2.Item, PointB=list_item_2.Item2)
unit_z_2 = UnitZ(Factor=distance_2)
set_material_5 = SetMaterial(Object=mesh_join_5, Material=add_material_4)  # -> Object, Material
set_material_6 = SetMaterial(Object=mesh_join_6, Material=add_material_5)  # -> Object, Material
list_item_3 = ListItem(List=discontinuity_3.Points, Index=0, Wrap=True)  # -> Item, Item1, Item2
move = Move(Geometry=center.Center, Motion=unit_z)  # -> Geometry, Transform
number_slider = Slider(1.11, range=0..10)
move_2 = Move(Geometry=center_2.Center, Motion=unit_z_2)  # -> Geometry, Transform
number_slider_2 = Slider(1.11, range=0..10)
distance_3 = Distance(PointA=list_item_3.Item, PointB=list_item_3.Item2)
unit_z_3 = UnitZ(Factor=distance_3)
entwine = Entwine(Branch00=set_material_3.Object, Branch01=set_material_2.Object, Branch02=set_material.Object, FlattenInputs=True)
move_3 = Move(Geometry=center_3.Center, Motion=unit_z_3)  # -> Geometry, Transform
number_slider_3 = Slider(1.11, range=0..10)
point_light = PointLight(
    Location=move.Geometry,
    Enabled=Toggle(True),
    Intensity=Slider(1.11, range=0..10),
    ShadowIntensity=number_slider,
    Falloff=number_slider)  # -> PointLight, Location
render_trigger = RenderTrigger(Button=Button())
point_light_2 = PointLight(
    Location=move_2.Geometry,
    Enabled=Toggle(True),
    Intensity=Slider(1.11, range=0..10),
    ShadowIntensity=number_slider_2,
    Falloff=number_slider_2)  # -> PointLight, Location
shift_paths = ShiftPaths(Data=entwine, Offset=-1)
render_trigger_2 = RenderTrigger(Button=Button())
entwine_2 = Entwine(Branch00=set_material_6.Object, Branch01=set_material_5.Object, FlattenInputs=True)
point_light_3 = PointLight(
    Location=move_3.Geometry,
    Enabled=Toggle(True),
    Intensity=Slider(1.11, range=0..10),
    ShadowIntensity=number_slider_3,
    Falloff=number_slider_3)  # -> PointLight, Location
production_render = ProductionRender(
    Geometry=set_material_4.Object,
    Lights=point_light.PointLight,
    Width=800,
    Height=600,
    Passes=Slider(1500, range=0..10000),
    Transparent=Toggle(True),
    ZoomToSubject=Toggle(True),
    ExperimentalDisplacement=Toggle(False),
    Run=render_trigger,
    Channels="RGBA",
    EnabledChannels="RGBA,Wireframe,Depth,Normal,Albedo,MaterialID,ObjectID")  # -> Package, Preview, Log, RImageFile
shift_paths_2 = ShiftPaths(Data=entwine_2, Offset=-1)
render_trigger_3 = RenderTrigger(Button=Button())
production_render_2 = ProductionRender(
    Geometry=shift_paths,
    Lights=point_light_2.PointLight,
    Width=800,
    Height=600,
    Passes=Slider(1500, range=0..10000),
    Transparent=Toggle(True),
    ZoomToSubject=Toggle(True),
    ExperimentalDisplacement=Toggle(False),
    Run=render_trigger_2,
    Channels="RGBA",
    EnabledChannels="RGBA,Wireframe,Depth,Normal,Albedo,MaterialID,ObjectID")  # -> Package, Preview, Log, RImageFile
production_render_3 = ProductionRender(
    Geometry=shift_paths_2,
    Lights=point_light_3.PointLight,
    Width=800,
    Height=600,
    Passes=Slider(1500, range=0..10000),
    Transparent=Toggle(True),
    ZoomToSubject=Toggle(True),
    ExperimentalDisplacement=Toggle(False),
    Run=render_trigger_3,
    Channels="RGBA",
    EnabledChannels="RGBA,Wireframe,Depth,Normal,Albedo,MaterialID,ObjectID")  # -> Package, Preview, Log, RImageFile
read_rimage = ReadRImage(File=production_render.RImageFile, Run=Toggle(True), EnabledChannels="RGBA,Depth,Normal,Albedo,MaterialID,ObjectID")  # -> RGBA, Depth, Normal, Albedo, MaterialID, ObjectID, Info
read_rimage_2 = ReadRImage(File=production_render_2.RImageFile, Run=Toggle(True), EnabledChannels="RGBA,Depth,Normal,Albedo,MaterialID,ObjectID")  # -> RGBA, Depth, Normal, Albedo, MaterialID, ObjectID, Info
deconstruct_render = DeconstructRender(Package=production_render.Package)  # -> RGBA, Alpha, Depth, Normal, Albedo, DiffuseLighting, MaterialID, ObjectID, Wireframe, Info
deconstruct_render_2 = DeconstructRender(Package=production_render_2.Package)  # -> RGBA, Alpha, Depth, Normal, Albedo, DiffuseLighting, MaterialID, ObjectID, Wireframe, Info
read_rimage_3 = ReadRImage(File=production_render_3.RImageFile, Run=Toggle(True), EnabledChannels="RGBA,Depth,Normal,Albedo,MaterialID,ObjectID")  # -> RGBA, Depth, Normal, Albedo, MaterialID, ObjectID, Info
deconstruct_render_3 = DeconstructRender(Package=production_render_3.Package)  # -> RGBA, Alpha, Depth, Normal, Albedo, DiffuseLighting, MaterialID, ObjectID, Wireframe, Info
render_viewer = RenderViewer(Bitmap=deconstruct_render.RGBA, SavePath=concatenate_2, Format="PNG", PreviewScale=1)  # -> FilePath, Success
render_viewer_2 = RenderViewer(Bitmap=deconstruct_render_2.RGBA, SavePath=concatenate, Format="PNG", PreviewScale=1)  # -> FilePath, Success
render_viewer_3 = RenderViewer(Bitmap=deconstruct_render_3.RGBA, SavePath=concatenate_3, Format="PNG", PreviewScale=1)  # -> FilePath, Success
